# Grasshopper definition cdf_assignment1.ghx (Grasshopper 1.0.8)

number_slider = Slider(0.505, range=0..1)
pt = Point()

# ---- group: Example: Build a Parametric Cone
pt_2 = Point(Point(-0.4439523925, 0.05137995213, 0))
cone = Python3Script(pt=pt_2, h=Slider(1, range=1..10), r=Slider(1, range=1..10))  # -> out, my_cone; inputs pt: Point3d
# ---------- cone: Python ----------
# import function
from cdf import create_cone

# call function
my_cone = create_cone(base_point=pt, height=h, radius=r)
# ---------- end cone ----------

# ---- group: Boat
pt_3 = ConstructPoint(XCoordinate=Slider(70, range=0..200), YCoordinate=Slider(28, range=0..200), ZCoordinate=Slider(7, range=0..200))
pt_4 = ConstructPoint(XCoordinate=Slider(30, range=0..200), YCoordinate=Slider(22, range=0..200), ZCoordinate=Slider(7, range=0..200))
pt_5 = ConstructPoint(XCoordinate=Slider(40, range=0..200), YCoordinate=Slider(28, range=0..200), ZCoordinate=Slider(7, range=0..200))
pt_6 = ConstructPoint(XCoordinate=Slider(40, range=0..200), YCoordinate=Slider(16, range=0..200), ZCoordinate=Slider(7, range=0..200))
pt_7 = ConstructPoint(XCoordinate=Slider(70, range=0..200), YCoordinate=Slider(16, range=0..200), ZCoordinate=Slider(7, range=0..200))
polyline = Python3Script(p1=pt_7, p2=pt_6, p3=pt_4, p4=pt_5, p5=pt_3)  # -> out, boat_curve; inputs p1: Point3d, p2: Point3d, p3: Point3d, p4: Point3d, p5: Point3d
# ---------- polyline: Python ----------
# import function
from cdf import create_polyline

# call function
boat_curve = create_polyline(
    points=[p1, p2, p3, p4, p5],
    closed=True
)
# ---------- end polyline ----------
Z = UnitZ(Factor=Slider(4, range=0..200))
extr = Extrude(Base=polyline.boat_curve, Direction=Z)
cap = CapHoles(Brep=extr)
preview = CustomPreview(Geometry=cap, Material=ColourSwatch(SwatchColor=RGB(26, 176, 240)))
pt_8 = ConstructPoint(XCoordinate=Slider(36, range=0..200), YCoordinate=Slider(22, range=0..200), ZCoordinate=Slider(11, range=0..200))
pt_9 = ConstructPoint(XCoordinate=Slider(58, range=0..200), YCoordinate=Slider(22, range=0..200), ZCoordinate=Slider(40, range=0..200))
pt_10 = ConstructPoint(XCoordinate=Slider(58, range=0..200), YCoordinate=Slider(22, range=0..200), ZCoordinate=Slider(11, range=0..200))
polyline_2 = Python3Script(p1=pt_10, p2=pt_9, p3=pt_8)  # -> out, sail_curve; inputs p1: Point3d, p2: Point3d, p3: Point3d
# ---------- polyline_2: Python ----------
# import function
from cdf import create_polyline

# call function
sail_curve = create_polyline(
    points=[p1, p2, p3],
    closed=True
)
# ---------- end polyline_2 ----------
boundary = BoundarySurfaces(Edges=polyline_2.sail_curve)
preview_2 = CustomPreview(Geometry=boundary, Material=ColourSwatch(SwatchColor=RGB(232, 232, 232)))

# ---- group: Auto-reloads cdf module on VScode changes
# Setting path for Src AutoReloader: 1. Right click on Path
# 2. Choose "Select a directory"
# 3. Locate the ..\cdf1_teaching\src folder in your computer
# NOTES:
# 
# - Use Python 3 Script blocks for your functions.
# - Import your functions and classes as: from cdf import my_function, My_class
# - Don't forget to add and name your INPUT and OUTPUT parameters that match your functions correctly. If you zoom in to the Python component you will see the + sign to add and - to remove them.
# - You need to attach the accurate components to your INPUT parameters: sliders for integers or floats, toggles or buttons for booleans, text for strings, Rhino geometries etc. etc.
# - If an INPUT is  a list, you need to right-click the parameter to set it as LIST access. Sometimes you need to also set the type of the INPUT by clicking TYPE HINT and selecting the correct input type.
# - If you want to hide an object, right-click component and uncheck Preview. To visualize again, check Preview.
# - If you get errors, READ THEM! They often tell what's wrong in a simple language. If not, copy-paste to CoPilot and don't be afraid to play around!
# 
# For more Grasshopper Help, go to:
# https://developer.rhino3d.com/guides/scripting/scripting-component/#script-inputs-and-outputs
path = FilePath("D:\CDF\cdf1_teaching\src\")
autoreloader = Python3Script(src_path=path)  # -> out; inputs src_path: String
# ---------- autoreloader: Python ----------
#! python3
import sys, os, time
import scriptcontext as sc
import Rhino, System
from System.IO import FileSystemWatcher, NotifyFilters

VERSION = 1  
pkg = "cdf"

if not src_path:
    raise Exception("Connect a folder to src_path.")
path = os.path.normpath(src_path)
watch_dir = os.path.join(path, pkg)
if not os.path.isdir(watch_dir):
    raise Exception("No '{}' folder found in:\n{}".format(pkg, path))

def unload():
    for name in list(sys.modules):
        if name == pkg or name.startswith(pkg + "."):
            del sys.modules[name]

# Put this folder first in Python's search list
if path in sys.path:
    sys.path.remove(path)
sys.path.insert(0, path)

key = "cdf_watcher_" + str(ghenv.Component.InstanceGuid)
time_key = key + "_time"
version_key = key + "_version"

def stamp():
    sc.sticky[time_key] = time.strftime("%Y-%m-%d %H:%M:%S")

# Replace the old watcher if the folder changed or the script was updated
old = sc.sticky.get(key)
if old is not None and (os.path.normpath(old.Path) != watch_dir
                        or sc.sticky.get(version_key) != VERSION):
    old.Dispose()
    del sc.sticky[key]
    unload()

if key not in sc.sticky:
    comp = ghenv.Component
    last = [0.0]

    def reload_and_rerun():
        unload()
        stamp()
        doc = comp.OnPingDocument()
        if doc is None:            # reloader was deleted or the file closed
            return
        for obj in doc.Objects:
            if "Python" in obj.GetType().Name:
                obj.ExpireSolution(False)   # mark as out of date
        doc.NewSolution(False)              # recompute once

    def on_change(sender, e):
        if not e.FullPath.endswith(".py") or "__pycache__" in e.FullPath:
            return
        if time.time() - last[0] < 0.5:     # ignore the second event of a double save
            return
        last[0] = time.time()
        Rhino.RhinoApp.InvokeOnUiThread(System.Action(reload_and_rerun))

    w = FileSystemWatcher(watch_dir, "*.py")
    w.IncludeSubdirectories = True
    w.NotifyFilter = NotifyFilters.LastWrite
    w.Changed += on_change
    w.EnableRaisingEvents = True
    sc.sticky[key] = w
    sc.sticky[version_key] = VERSION
    stamp()                                  # time the watcher started

msg = "Last reloaded: {}\nWatching: {}".format(sc.sticky.get(time_key, "unknown"), watch_dir)
print(msg)
out = msg
# ---------- end autoreloader ----------
panel = Panel(autoreloader)

# ---- group: Island
dom = ConstructDomain(DomainStart=Slider(105, range=0..200), DomainEnd=Slider(155, range=0..200))
dom_2 = ConstructDomain(DomainStart=Slider(18, range=0..200), DomainEnd=Slider(32, range=0..200))
dom_3 = ConstructDomain(DomainStart=Slider(15, range=0..200), DomainEnd=Slider(60, range=0..200))
dom_4 = ConstructDomain(DomainStart=Slider(95, range=0..200), DomainEnd=Slider(175, range=0..200))
dom_5 = ConstructDomain(DomainStart=Slider(6, range=0..200), DomainEnd=Slider(18, range=0..200))
dom_6 = ConstructDomain(DomainStart=Slider(10, range=0..200), DomainEnd=Slider(100, range=0..200))
box = DomainBox(Base=PlaneXY(0, 0, 0), X=dom, Y=dom_3, Z=dom_2)
box_2 = DomainBox(Base=PlaneXY(0, 0, 0), X=dom_4, Y=dom_6, Z=dom_5)
dom_7 = ConstructDomain(DomainStart=Slider(135, range=0..200), DomainEnd=Slider(175, range=0..200))
dom_8 = ConstructDomain(DomainStart=Slider(18, range=0..200), DomainEnd=Slider(45, range=0..200))
dom_9 = ConstructDomain(DomainStart=Slider(105, range=0..200), DomainEnd=Slider(135, range=0..200))
dom_10 = ConstructDomain(DomainStart=Slider(18, range=0..200), DomainEnd=Slider(55, range=0..200))
dom_11 = ConstructDomain(DomainStart=Slider(55, range=0..200), DomainEnd=Slider(100, range=0..200))
dom_12 = ConstructDomain(DomainStart=Slider(60, range=0..200), DomainEnd=Slider(100, range=0..200))
box_3 = DomainBox(Base=PlaneXY(0, 0, 0), X=dom_7, Y=dom_11, Z=dom_8)
box_4 = DomainBox(Base=PlaneXY(0, 0, 0), X=dom_9, Y=dom_12, Z=dom_10)

# ---- group: Light_house
dom_13 = ConstructDomain(DomainStart=Slider(150, range=0..200), DomainEnd=Slider(165, range=0..200))
dom_14 = ConstructDomain(DomainStart=Slider(18, range=0..200), DomainEnd=Slider(130, range=0..200))
dom_15 = ConstructDomain(DomainStart=Slider(65, range=0..200), DomainEnd=Slider(100, range=0..200))
pt_11 = ConstructPoint(XCoordinate=Slider(157.5, range=0..200), YCoordinate=Slider(82.5, range=0..200), ZCoordinate=Slider(103, range=0..200))
sphere = Python3Script(pt=pt_11, r=Slider(13, range=0..100))  # -> out, sphere; inputs pt: Point3d
# ---------- sphere: Python ----------
# import function
from cdf import create_sphere

# call function
sphere = create_sphere(center_point=pt, radius=r)
# ---------- end sphere ----------
light_house = DomainBox(Base=PlaneXY(0, 0, 0), X=dom_13, Y=dom_15, Z=dom_14)
pt_12 = ConstructPoint(XCoordinate=Slider(143, range=0..200), YCoordinate=Slider(100, range=0..200), ZCoordinate=Slider(130, range=0..200))
pt_13 = ConstructPoint(XCoordinate=Slider(143, range=0..200), YCoordinate=Slider(65, range=0..200), ZCoordinate=Slider(130, range=0..200))
pt_14 = ConstructPoint(XCoordinate=Slider(143, range=0..200), YCoordinate=Slider(100, range=0..200), ZCoordinate=Slider(116, range=0..200))
X = UnitX(Factor=Slider(41, range=0..200))
boolean = Python3Script(Light_house=light_house, sphere=sphere.sphere)  # -> out, reverse(Light_house1); inputs Light_house: Brep, sphere: Brep
# ---------- boolean: Python ----------
# import function
from cdf import boolean_difference

# call function
Light_house1 = boolean_difference(brep_a=Light_house, brep_b=sphere)
# ---------- end boolean ----------
polyline_3 = Python3Script(p1=pt_14, p2=pt_13, p3=pt_12)  # -> out, triangle_curve; inputs p1: Point3d, p2: Point3d, p3: Point3d
# ---------- polyline_3: Python ----------
# import function
from cdf import create_polyline

# call function
triangle_curve = create_polyline(
    points=[p1, p2, p3],
    closed=True
)
# ---------- end polyline_3 ----------
extr_2 = Extrude(Base=polyline_3.triangle_curve, Direction=X)
swatch = ColourSwatch(SwatchColor=RGB(247, 102, 17))
boolean_2 = Python3Script(Light_house1=boolean.Light_house1, triangle=extr_2)  # -> out, result_geometry; inputs Light_house1: Brep, triangle: Brep
# ---------- boolean_2: Python ----------
# import function
from cdf import boolean_difference

# call function
result_geometry = boolean_difference(brep_a=Light_house1, brep_b=triangle)

from cdf import boolean_difference
# ---------- end boolean_2 ----------

# ---- group: Waves
pt_15 = ConstructPoint(XCoordinate=Slider(58, range=0..200), YCoordinate=Slider(32, range=0..200), ZCoordinate=Slider(7, range=0..200))
pt_16 = ConstructPoint(XCoordinate=Slider(38, range=0..200), YCoordinate=Slider(32, range=0..200), ZCoordinate=Slider(27, range=0..200))
pt_17 = ConstructPoint(XCoordinate=Slider(16, range=0..200), YCoordinate=Slider(32, range=0..200), ZCoordinate=Slider(7, range=0..200))
arc = Python3Script(p1=pt_17, p2=pt_16, p3=pt_15)  # -> out, my_arc; inputs p1: Point3d, p2: Point3d, p3: Point3d
# ---------- arc: Python ----------
# import function
from cdf import create_arc

# call function
my_arc = create_arc(
    point_a=p1,
    point_b=p2,
    point_c=p3
)
# ---------- end arc ----------
pt_18 = ConstructPoint(XCoordinate=Slider(10, range=0..200), YCoordinate=Slider(45, range=0..200), ZCoordinate=Slider(7, range=0..200))
progressive_array = Python3Script(
    geo=arc.my_arc,
    count=Slider(6, range=0..200),
    spacing=Slider(10, range=0..200),
    scale_step=Slider(0.15, range=0..200),
    origin=pt_18)  # -> out, waves1; inputs geo: Curve, count: Int32, origin: Point3d
# ---------- progressive_array: Python ----------
# import function

from cdf import create_progressive_array
# call function
waves1 = create_progressive_array(
    geometry=geo,
    count=count,
    translation=(0, spacing, 0),
    scale_step=(scale_step, 0, scale_step),
    origin=origin
)
# ---------- end progressive_array ----------
pipe = Python3Script(wave_curves=progressive_array.waves1, r=Slider(1.445, range=0..10))  # -> out, waves2; inputs wave_curves: Curve, r: Double
# ---------- pipe: Python ----------
# import function
from cdf import create_progressive_array, create_pipe

# call function
waves2 = create_pipe(
    curves=wave_curves,
    radius=r
)
# ---------- end pipe ----------
preview_3 = CustomPreview(Geometry=pipe.waves2, Material=ColourSwatch(SwatchColor=RGB(145, 224, 255)))

# ---- group: TODO: Build a Parametric Sphere
sphere_2 = Python3Script(pt=pt, r=Slider(1, range=0..10))  # -> out, my_sphere; inputs pt: Point3d
# ---------- sphere_2: Python ----------
# import function
from cdf import create_sphere

# call function
my_sphere = create_sphere(center_point=pt, radius=r)
# ---------- end sphere_2 ----------

# ---- group: TODO: Make Transformations
transformation = Python3Script(my_sphere=sphere_2.my_sphere, distance=Slider(3, range=1..10), count=Slider(2, range=1..10))  # -> out, my_spheres; inputs my_sphere: Brep
# ---------- transformation: Python ----------
from cdf import copy_brep_along_z

my_spheres = copy_brep_along_z(my_sphere, distance, count)
# ---------- end transformation ----------

# ---- group: REAL LIGHT
pt_19 = ConstructPoint(XCoordinate=Slider(164, range=0..200), YCoordinate=Slider(84, range=0..200), ZCoordinate=Slider(110, range=0..200))
cone_2 = Python3Script(pt=pt_19, h=Slider(175, range=1..1000), r=Slider(68, range=1..200))  # -> out, my_cone; inputs pt: Point3d; same code as cone
Y = UnitY(Factor=1)
rot3d = Rotate3D(Geometry=cone_2.my_cone, Angle=Slider(3.731, range=0..5), Center=pt_19, Axis=Y)  # -> Geometry, Transform

# ---- group: TODO: Make a Boolean Difference
boolean_3 = Python3Script(my_cone=cone.my_cone, my_sphere=sphere_2.my_sphere)  # -> out, result_geometry; inputs my_cone: Brep, my_sphere: Brep
# ---------- boolean_3: Python ----------
# import function
from cdf import boolean_difference

# call function
result_geometry = boolean_difference(brep_a=my_cone, brep_b=my_sphere)
# ---------- end boolean_3 ----------

# ---- group: Sea
dom_16 = ConstructDomain(DomainStart=Slider(10, range=0..200), DomainEnd=Slider(175, range=0..200))
dom_17 = ConstructDomain(DomainStart=Slider(6, range=0..200), DomainEnd=Slider(7, range=0..200))
dom_18 = ConstructDomain(DomainStart=Slider(10, range=0..200), DomainEnd=Slider(110, range=0..200))
box_5 = DomainBox(Base=PlaneXY(0, 0, 0), X=dom_16, Y=dom_18, Z=dom_17)

# ---- group: horizon
dom_19 = ConstructDomain(DomainStart=Slider(10, range=0..200), DomainEnd=Slider(200, range=0..200))
dom_20 = ConstructDomain(DomainStart=Slider(-50, range=-50..200), DomainEnd=Slider(200, range=0..200))
dom_21 = ConstructDomain(DomainStart=Slider(120, range=0..200), DomainEnd=Slider(200, range=0..200))
pt_20 = ConstructPoint(XCoordinate=Slider(110, range=0..200), YCoordinate=Slider(110, range=0..200), ZCoordinate=Slider(27, range=0..200))
pt_21 = ConstructPoint(XCoordinate=Slider(110, range=0..200), YCoordinate=Slider(16.1, range=0..200), ZCoordinate=Slider(34, range=0..200))
sphere_3 = Python3Script(pt=pt_20, r=Slider(74, range=0..100))  # -> out, sphere1; inputs pt: Point3d
# ---------- sphere_3: Python ----------
# import function
from cdf import create_sphere

# call function
sphere1 = create_sphere(center_point=pt, radius=r)
# ---------- end sphere_3 ----------
box_6 = DomainBox(Base=PlaneXY(0, 0, 0), X=dom_19, Y=dom_21, Z=dom_20)
sphere_4 = Python3Script(pt=pt_21, r=Slider(113, range=0..200))  # -> out, sphere2; inputs pt: Point3d
# ---------- sphere_4: Python ----------
# import function
from cdf import create_sphere

# call function
sphere2 = create_sphere(center_point=pt, radius=r)
# ---------- end sphere_4 ----------
dom_22 = ConstructDomain(DomainStart=Slider(10, range=0..200), DomainEnd=Slider(200, range=0..200))
dom_23 = ConstructDomain(DomainStart=Slider(-50, range=-50..200), DomainEnd=Slider(0, range=0..200))
dom_24 = ConstructDomain(DomainStart=Slider(0, range=0..200), DomainEnd=Slider(200, range=0..200))
boolean_4 = Python3Script(sphere1=sphere_3.sphere1, box=box_6)  # -> out, reverse(horizon1); inputs sphere1: Brep, box: Brep
# ---------- boolean_4: Python ----------
# import function
from cdf import boolean_difference

# call function
horizon1 = boolean_difference(brep_a=sphere1, brep_b=box)
# ---------- end boolean_4 ----------
box_7 = DomainBox(Base=PlaneXY(0, 0, 0), X=dom_22, Y=dom_24, Z=dom_23)
boolean_5 = Python3Script(horizon1=boolean_4.horizon1, box=sphere_4.sphere2)  # -> out, reverse(horizon2); inputs horizon1: Brep, box: Brep
# ---------- boolean_5: Python ----------
# import function
from cdf import boolean_difference

# call function
horizon2 = boolean_difference(brep_a=horizon1, brep_b=box)
# ---------- end boolean_5 ----------

# ---- group: Base
box_8 = DomainBox(Base=PlaneXY(0, 0, 0), X=Slider(180, range=0..200), Y=Slider(120, range=0..200), Z=Slider(6, range=0..200))

# ---- group: light
pt_22 = ConstructPoint(XCoordinate=Slider(-4, range=-50..200), YCoordinate=Slider(111, range=0..200), ZCoordinate=Slider(27, range=0..200))
pt_23 = ConstructPoint(XCoordinate=Slider(0, range=0..200), YCoordinate=Slider(0, range=0..200), ZCoordinate=Slider(-2, range=-50..200))
pt_24 = ConstructPoint(XCoordinate=Slider(177, range=0..200), YCoordinate=Slider(14, range=-50..200), ZCoordinate=Slider(47, range=0..200))
pt_25 = ConstructPoint(XCoordinate=Slider(159, range=0..200), YCoordinate=Slider(116, range=0..200), ZCoordinate=Slider(73, range=0..200))
curve = Python3Script(p1=pt_25, p2=pt_24, p3=pt_22, p4=pt_23)  # -> out, my_curve; inputs p1: Point3d, p2: Point3d, p3: Point3d, p4: Point3d
# ---------- curve: Python ----------
# import function
from cdf import create_interpolated_curve

my_curve = create_interpolated_curve(
    points=[p1, p2, p3, p4],
    degree=3
)
# ---------- end curve ----------
ribbon = Python3Script(curve=curve.my_curve, width=Slider(2, range=0..200), thickness=Slider(6, range=0..200))  # -> out, ribbon; inputs curve: Curve, width: Double, thickness: Double
# ---------- ribbon: Python ----------
# import function
from cdf import create_ribbon

ribbon = create_ribbon(
    curve=curve,
    width=width,
    thickness=thickness
)

print("STEP 1: Python started")


ribbon = create_ribbon(
    curve=curve,
    width=width,
    thickness=thickness
)

print("STEP 3: Ribbon created")
print("Ribbon count:", len(ribbon))

for i, brep in enumerate(ribbon):
    print("Ribbon", i, "IsSolid:", brep.IsSolid)
# ---------- end ribbon ----------

# ---- group: Visualize
preview_4 = CustomPreview(Geometry=cone.my_cone, Material=ColourSwatch(SwatchColor=RGB(60, 230, 88)))

preview_5 = CustomPreview(Geometry=sphere_2.my_sphere, Material=ColourSwatch(SwatchColor=RGB(255, 86, 88)))

preview_6 = CustomPreview(Geometry=boolean_3.result_geometry, Material=ColourSwatch(SwatchColor=RGB(255, 86, 255)))

preview_7 = CustomPreview(Geometry=transformation.my_spheres, Material=ColourSwatch(SwatchColor=RGB(255, 255, 96)))

# ----
preview_8 = CustomPreview(Geometry=box_8, Material=ColourSwatch(SwatchColor=RGB(247, 247, 247)))
preview_9 = CustomPreview(Geometry=box_5, Material=ColourSwatch(SwatchColor=RGB(17, 32, 247)))
boolean_6 = Python3Script(horizon1=boolean_5.horizon2, box=box_7)  # -> out, reverse(horizon2); inputs horizon1: Brep, box: Brep; same code as boolean_5
preview_10 = CustomPreview(Geometry=box_4, Material=swatch)
preview_11 = CustomPreview(Geometry=box, Material=ColourSwatch(SwatchColor=RGB(227, 227, 227)))
preview_12 = CustomPreview(Geometry=box_2, Material=ColourSwatch(SwatchColor=RGB(242, 121, 51)))
preview_13 = CustomPreview(Geometry=box_3, Material=ColourSwatch(SwatchColor=RGB(227, 227, 227)))
preview_14 = CustomPreview(Geometry=boolean.Light_house1, Material=ColourSwatch(SwatchColor=RGB(237, 9, 9)))
